# Grasshopper definition make path.gh (Grasshopper 1.0.7)

curve = Curve([<curve referenced from the Rhino model> x2])
vector_xyz = VectorXYZ(XComponent=Slider(100, range=0..100), YComponent=0, ZComponent=0)  # -> Vector, Length
move = Move(Geometry=curve, Motion=vector_xyz.Vector)  # -> Geometry, Transform
wall_piece_spacing = Slider(5, range=1..20)
material_thickness = Slider(3, range=1..10)
section = Slider(1, range=0..10)
inside_shape = BooleanToggle(True)
left_side = BooleanToggle(False)
tab_width = Slider(5, range=5..50)
make_tabs = BooleanToggle(True)
tab_height = Slider(8, range=5..50)
debug = BooleanToggle(False)

# ---- group: Generate Tabs
explode = Explode(Curve=move.Geometry, Recursive=True)  # -> Segments, Vertices

# ----
simplify_tree = SimplifyTree(Tree=explode.Segments, Front=False)
flatten_tree = FlattenTree(Tree=simplify_tree, Path="{0}")

# ---- group: Generate Tabs (continued)
panel = Panel(simplify_tree)

# ----
curve_direction_helper = GhPythonScript(curves=flatten_tree)  # -> out, a; inputs curves: list of Curve
# ---------- curve_direction_helper: Python ----------
import Rhino.Geometry as rg

arrows = []

arrowSize = 3.0

for crv in curves:

    # midpoint parameter
    t = crv.Domain.Mid

    # midpoint
    pt = crv.PointAt(t)

    # tangent
    tan = crv.TangentAt(t)
    tan.Unitize()

    # arrow end
    endPt = pt + (tan * arrowSize)

    # main arrow shaft
    arrows.append(rg.Line(pt, endPt))

    # arrowhead
    perp = rg.Vector3d(-tan.Y, tan.X, 0)
    perp.Unitize()

    headBack = endPt - (tan * (arrowSize * 0.3))

    left = headBack + (perp * (arrowSize * 0.2))
    right = headBack - (perp * (arrowSize * 0.2))

    arrows.append(rg.Line(endPt, left))
    arrows.append(rg.Line(endPt, right))


a = arrows
# ---------- end curve_direction_helper ----------

# ---- group: Walls and Tabs
height = Slider(32, range=10..200)
make_cut_pattern = GhPythonScript(
    showdebug=debug,
    inside=inside_shape,
    inputParts=simplify_tree,
    section=section,
    index=Slider(4, range=0..10),
    height=height,
    tabs=make_tabs,
    depth=material_thickness,
    width=tab_width,
    side=left_side,
    wallPathSpace=wall_piece_spacing,
    tabHeight=tab_height)  # -> out, horizontal, vertical, placedHoles, kerf_left, kerf_bottom, isCurve, debug; inputs showdebug: Boolean, inside: Boolean, inputParts: tree of Curve, section: Int32, index: Int32, tabs: Boolean, side: Boolean, wallPathSpace: Int32, tabHeight: Int32
# ---------- make_cut_pattern: Python ----------
import Rhino.Geometry as rg

#Select parts, and get state of it
section = int(section)
branch = inputParts.Branch(section)
#index = int(index) % len(branch)
index = int(index)
count = len(branch)

curve = branch[index % count]
prevCurve = branch[(index - 1) % count]
nextCurve = branch[(index + 1) % count]

prevIsLine = prevCurve.IsLinear()
nextIsLine = nextCurve.IsLinear()
invertPattern = (index % 2 == 0)

# vertical tab height
tabHeight = int(tabHeight)

#spacing for each piece of wall
wallPathSpace = int(wallPathSpace)

baseHoles = []

#output geom
horizontal = []
vertical = []
placedHoles = []

#debug geom
debug = []

# measure length of line, and make across X
length = curve.GetLength()
isCurve = not curve.IsLinear()

tabcount = int(round((length - width) / width / 2))
# make tabs
# would be a list on tab 0 at 0, width, tab 1 at (1 * 2 width) + (1 * 2 width) + width 
totalWidth = (tabcount * width) + ((tabcount - 1) * width)
offset = (length - totalWidth) / 2

def makeTabLine(x1,y1,x2,y2):
    return rg.Line(
        rg.Point3d(x1,y1,0),
        rg.Point3d(x2,y2,0)
    )

def makeVerticalTabs(xPos, left = False, invert=False, inside=False):
    sideLines = []

    usable = height
    vcount = int(round((usable - tabHeight) / tabHeight / 2))

    if vcount < 1:
        return sideLines

    total = (vcount * tabHeight) + ((vcount - 1) * tabHeight)
    voffset = (usable - total) / 2

    #set up direction 
    x1 = xPos + (depth * (-1 if left else 1) * (1 if invert else 0)) - (depth  * (-1 if left else 1) * (1 if inside else 0))
    x2 = x1 + (depth * (-1 if left else 1) * (-1 if invert else 1))
    
    #start line
    if inside:
        print("draw little connecting tab to smaller size")
    
    
    if x1 != xPos:
        sideLines.append(makeTabLine(x1, 0, x2, 0))
    sideLines.append(makeTabLine(x1, 0, x1, voffset))
    
    #do tabs
    for i in range(vcount):

        y1 = i * 2 * tabHeight + voffset
        y2 = y1 + tabHeight
        sideLines.append(makeTabLine(x1, y1, x2, y1))
        sideLines.append(makeTabLine(x2, y1, x2, y2))
        sideLines.append(makeTabLine(x2, y2, x1, y2))
        if i < vcount-1: 
            sideLines.append(makeTabLine(x1, y2, x1, y2+tabHeight))

    #do end
    if x1 != xPos:
        sideLines.append(makeTabLine(x1, usable, x2, usable))
    sideLines.append(makeTabLine(x1, usable - voffset, x1, usable))

    return sideLines
    
def isLineBoundary(i):
    if not branch[i].IsLinear():
        return False

    nextI = (i + 1) % count
    return branch[nextI].IsLinear()
    
def findPrevBoundary(startIndex):
    i = (startIndex - 1) % count

    while i != startIndex:
        if isLineBoundary(i):
            return i
        i = (i - 1) % count

    return None


def findNextBoundary(startIndex):
    i = (startIndex + 1) % count

    while i != startIndex:
        if isLineBoundary(i):
            return i
        i = (i + 1) % count

    return None
    
def moveLines(lines, dx):
    moved = []

    xform = rg.Transform.Translation(dx, 0, 0)

    for ln in lines:
        copy = rg.Line(ln.From, ln.To)
        copy.Transform(xform)
        moved.append(copy)

    return moved
    
def cornerDirection(a, b):

    ta = a.TangentAt(a.Domain.Max)
    tb = b.TangentAt(b.Domain.Min)

    ta.Unitize()
    tb.Unitize()

    cross = rg.Vector3d.CrossProduct(ta, tb)

    return cross.Z

def debugCorner(a, b):

    ta = a.TangentAt(a.Domain.Max)
    tb = b.TangentAt(b.Domain.Min)

    ta.Unitize()
    tb.Unitize()

    pt = a.PointAtEnd

    scale = 5

    lineA = rg.Line(pt, pt + ta * scale)
    lineB = rg.Line(pt, pt + tb * scale)

    cross = rg.Vector3d.CrossProduct(ta, tb)

    dot = rg.TextDot(str(round(cross.Z, 3)), pt)

    return lineA, lineB, dot

prevBoundary = findPrevBoundary(index)
nextBoundary = findNextBoundary(index)

# figure out inner / concave or outer / convex angle 

insideCornerLeft = cornerDirection(prevCurve, curve) > 0
insideCornerRight = cornerDirection(curve, nextCurve) > 0
A,B,D = debugCorner(prevCurve, curve)
if showdebug:
    debug = []
    debug.append(A)
    debug.append(B)
    debug.append(D)
print("Left %s. Right %s." % (insideCornerLeft, insideCornerRight))






if tabs and tabcount > 0 and not isCurve:
    # horizontal lines
    #horizontal.append(rg.Line(rg.Point3d(0,0,0), rg.Point3d(length, 0,0)))
    horizontal.append(rg.Line(rg.Point3d(0,height,0), rg.Point3d(length, height,0)))
    
    #horizontal.append(rg.Line(rg.Point3d(0,10,0), rg.Point3d(totalWidth, 10,0)))
    
    
    # for for start
    # for for end
    
    #for for middle
    tab_positions = []
    
    for i in range(0, tabcount):
        xPos1 = i * 2 * width + offset
        xPos2 = xPos1 + width
        tab_positions.append((xPos1, xPos2))
    
    
    # top baseline before first tab
    vertical.append(makeTabLine(0,0,0,-depth))
    horizontal.append(makeTabLine(0,-depth,tab_positions[0][0],-depth))
    # bottom
    baseHoles.append(makeTabLine(0,0,tab_positions[0][0],0))
    
    # create tab pattern on bottom of wall
    for i, (xPos1, xPos2) in enumerate(tab_positions):
    
        # tab bottom
        horizontal.append(makeTabLine(xPos1,0,xPos2,0))
        
        # hole bottom
        baseHoles.append(makeTabLine(xPos1,-depth,xPos2,-depth))
    
        # left vertical
        vertical.append(makeTabLine(xPos1,-depth,xPos1,0))
        baseHoles.append(makeTabLine(xPos1,-depth,xPos1,0))  
    
        # right vertical
        vertical.append(makeTabLine(xPos2,-depth,xPos2,0))
        baseHoles.append(makeTabLine(xPos2,-depth,xPos2,0))  
    
        # top segment to next tab
        if i < len(tab_positions)-1:
            nextStart = tab_positions[i+1][0]
            horizontal.append(makeTabLine(xPos2,-depth,nextStart,-depth))
            baseHoles.append(makeTabLine(xPos2,0,nextStart,0))  
    
    
    # top baseline after last tab
    
    vertical.append(makeTabLine(length,0,length,-depth))   
    horizontal.append(makeTabLine(tab_positions[-1][1],-depth,length,-depth))
    baseHoles.append(makeTabLine(tab_positions[-1][1],0,length,0))

    
    # transform base holes
    
    # -------------------------
    # TRANSFORM TO SOURCE LINE
    # -------------------------
    
    
    if side:
        start = curve.PointAtStart
        end = curve.PointAtEnd
    else:
        start = curve.PointAtEnd
        end = curve.PointAtStart
    
    xAxis = end - start
    xAxis.Unitize()
    
    yAxis = rg.Vector3d(-xAxis.Y, xAxis.X, 0)
    
    sourcePlane = rg.Plane.WorldXY
    targetPlane = rg.Plane(start, xAxis, yAxis)
    
    xform = rg.Transform.PlaneToPlane(sourcePlane, targetPlane)
    
    for hole in baseHoles:
        #copy = hole.Duplicate()
        #copy.Transform(xform)
        hole.Transform(xform)
        #placedHoles.append(copy)
        placedHoles.append(hole)
    
    # close paths on letter / shape outline
    placedHoles = [ln.ToNurbsCurve() for ln in placedHoles]
    placedHoles = rg.Curve.JoinCurves(placedHoles)
    
    
    #vertical
    if prevIsLine:
        vertical.extend(makeVerticalTabs(0, True, invertPattern, insideCornerLeft))
    else:
        vertical.append(rg.Line(rg.Point3d(0,0,0), rg.Point3d(0,height,0)))
    
    if nextIsLine:
        vertical.extend(makeVerticalTabs(length, False, invertPattern,insideCornerRight))
    else:
        vertical.append(rg.Line(rg.Point3d(length,0,0), rg.Point3d(length,height,0)))

else:
    
    
    # could be curve, so let's figure out our curves inside or outside and do offset if needed
    curveLength = length
    if inside:
        offsets = curve.Offset(    rg.Plane.WorldXY,    -depth,    0.01,    rg.CurveOffsetCornerStyle.Sharp )
        if showdebug:
            debug.append(offsets[0])
        curveLength = offsets[0].GetLength()
    # horizontal lines
    horizontal.append(rg.Line(rg.Point3d(0,-depth,0), rg.Point3d(curveLength, -depth,0)))
    horizontal.append(rg.Line(rg.Point3d(0,height,0), rg.Point3d(curveLength, height,0)))
    
    #vertical
    vertical.append(rg.Line(rg.Point3d(0,-depth,0), rg.Point3d(0, height,0)))
    vertical.append(rg.Line(rg.Point3d(curveLength,-depth,0), rg.Point3d(curveLength, height,0)))
    
    # base keep original geom
    placedHoles.append(curve)

    if isCurve:
        #do kern bending pattern
        kerf_left = rg.Line(rg.Point3d(0,-depth,0), rg.Point3d(curveLength, -depth,0))
        kerf_bottom = rg.Line(rg.Point3d(0,-depth,0), rg.Point3d(0, height,0))
# ---------- end make_cut_pattern ----------
panel_2 = Panel(make_cut_pattern.horizontal)

# ----
ghpython_script = GhPythonScript(
    bottom=make_cut_pattern.kerf_bottom,
    left=make_cut_pattern.kerf_left,
    l=Slider(31, range=20..40),
    dis=Slider(8, range=1..30),
    sp=Slider(1.5, range=1..5))  # -> out, pattern; inputs bottom: Line, left: Line
# ---------- ghpython_script: Python ----------
import Rhino.Geometry as rg

if bottom and left: 

    l = float(l)
    dis = float(dis)
    sp = float(sp)
    
    # Set the length of the segment
    L = bottom.Length
    x = (L/(l+dis))
    xint = int(x+0.5)
    d = L/xint-l
    
    L_2 = left.Length
    x_2 = (L_2/sp)
    xint_2 = int(x_2+0.5)
    s = L_2/xint_2
    
    
    #----------Generate pattern A----------#
    joins = []
    a = bottom.From
    joins.append(a)
    
    p = rg.Point3d(a.X, a.Y + (l/2), a.Z)
    joins.append(p)
    
    for i in range(1, xint):
        c = rg.Point3d(p.X, p.Y + d, p.Z)
        joins.append(c)
    
        p = rg.Point3d(c.X, c.Y + l, c.Z)
        joins.append(p)
    
    lj = len(joins)-1
    
    p = rg.Point3d(joins[lj].X, joins[lj].Y + d, joins[lj].Z)
    joins.append(p)
    
    c = rg.Point3d(p.X, p.Y + (l/2), p.Z)
    joins.append(c)
    
    pattern_A = []
    
    for i in range(0, len(joins)-1, 2):
        pattern_A.append(rg.Line(joins[i], joins[i+1]))
    
    
    #----------Generate pattern B----------#
    joins_2 = []
    joins_2.append(a)
    
    p_2 = rg.Point3d(a.X, a.Y+ (d/2), a.Z)
    joins_2.append(p_2)
    
    for i in range(1, xint+1):
        c_2 = rg.Point3d(p_2.X, p_2.Y + l, p_2.Z)
        joins_2.append(c_2)
    
        p_2 = rg.Point3d(c_2.X, c_2.Y + d, c_2.Z)
        joins_2.append(p_2)
    
    pattern_B = []
    
    for i in range(1, len(joins_2)-1, 2):
        pattern_B.append(rg.Line(joins_2[i], joins_2[i+1]))
    
    
    # Move pattern B
    p_B = []
    
    for line in pattern_B:
        p1 = rg.Point3d(line.FromX + s, line.FromY, line.FromZ)
        p2 = rg.Point3d(line.ToX + s, line.ToY, line.ToZ)
        p_B.append(rg.Line(p1, p2))
    
    
    # Copy rows
    all_patterns = []
    all_patterns.extend(pattern_A)
    all_patterns.extend(p_B)
    
    current_A = pattern_A[:]
    current_B = p_B[:]
    
    for i in range(0, xint_2-1, 2):
    
        new_A = []
        for line in current_A:
            p1 = rg.Point3d(line.FromX + s*2, line.FromY, line.FromZ)
            p2 = rg.Point3d(line.ToX + s*2, line.ToY, line.ToZ)
            new_A.append(rg.Line(p1, p2))
    
        new_B = []
        for line in current_B:
            p1 = rg.Point3d(line.FromX + s*2, line.FromY, line.FromZ)
            p2 = rg.Point3d(line.ToX+ s*2, line.ToY , line.ToZ)
            new_B.append(rg.Line(p1, p2))
    
        all_patterns.extend(new_A)
        all_patterns.extend(new_B)
    
        current_A = new_A
        current_B = new_B
    
    
    pattern = all_patterns
# ---------- end ghpython_script ----------
panel_3 = Panel(make_cut_pattern.out)
merge = Merge(
    Data1=make_cut_pattern.horizontal,
    Data2=make_cut_pattern.vertical,
    Data3=make_cut_pattern.placedHoles,
    Data4=ghpython_script.pattern)
